# Grasshopper definition chocolate mountains.gh (Grasshopper 0.9.76)

peaks = Slider(12, range=4..15)
factor = Slider(3, range=1..8)
random = Slider(16, range=1..20)
subtraction = Subtraction(A="25", B="21")
subtraction_2 = Subtraction(A="40", B="21")
division = Division(A="21", B=factor)
rectangle = Rectangle(Plane=PlaneXY(0, 0, 0), XSize=subtraction, YSize=subtraction_2, Radius=0)  # -> Rectangle, Length
dom = ConstructDomain(DomainStart=division, DomainEnd="21")
pcen = PolygonCenter(Polyline=rectangle.Rectangle)  # -> CenterV, CenterE, CenterA
pop2d = Populate2D(Region=rectangle.Rectangle, Count=peaks, Seed=1)
random_2 = Random(Range=Domain(5, 10), Number=peaks, Seed=random)
random_3 = Random(Range=dom, Number=peaks, Seed=random)
lenght = SortList(Keys=random_3)  # -> Keys, ValuesA
item = ListItem(List=lenght.Keys, Index=expr("x-1", peaks), Wrap=True)
item_2 = ListItem(List=lenght.Keys, Index=0, Wrap=True)
dom_2 = ConstructDomain(DomainStart=item_2, DomainEnd=expr("x\2", "25"))
dom_3 = ConstructDomain(DomainStart=item_2, DomainEnd=item)
dia_corr = RemapNumbers(Value=lenght.Keys, Source=dom_3, Target=dom_2)  # -> Mapped, Clipped
dist = Distance(PointA=pcen.CenterV, PointB=pop2d)
base_points = SortList(Keys=dist, ValuesA=pop2d)  # -> Keys, ValuesA
rev = ReverseList(List=lenght.Keys)
Z = UnitZ(Factor=rev)
division_2 = Division(A=dia_corr.Mapped, B=Slider(2.058, range=1..3))
division_3 = Division(A=dia_corr.Mapped, B=Slider(1, range=1..3))
top_points = Move(Geometry=base_points.ValuesA, Motion=Z)  # -> Geometry, Transform
cir = Circle(Plane=top_points.Geometry, Radius=division_2)
cir_sot = Circle(Plane=base_points.ValuesA, Radius=division_3)
mill_tip = Slider(1.616, range=1..3)
divide = DivideCurve(Curve=cir_sot, Count=2, Kinks=False)  # -> flatten(Points), Tangents, Parameters
divide_2 = DivideCurve(Curve=cir, Count=2, Kinks=False)  # -> flatten(Points), Tangents, Parameters
polygon = Polygon(Plane=base_points.ValuesA, Radius=dia_corr.Mapped, Segments=random_2, FilletRadius=mill_tip)  # -> Polygon, Length
weave = Weave(Pattern=[1, 0, 0, 1], Stream0=divide_2.Points, Stream1=divide.Points, NullGaps=False)
weave_2 = Weave(Pattern=[0, 0, 1, 0, 0], Stream0=weave, Stream1=top_points.Geometry, NullGaps=False)
partition = PartitionList(List=weave_2, Size=5)
nurbs = NurbsCurve(Vertices=partition, Degree=3, Periodic=False)  # -> Curve, Length, Domain
rotate = Rotate(Geometry=polygon.Polygon, Angle=division_3, Plane=base_points.ValuesA)  # -> Geometry, Transform
ln = Line(StartPoint=base_points.ValuesA, EndPoint=top_points.Geometry)
railrev = RailRevolution(Curve=flatten(nurbs.Curve), Rail=rotate.Geometry, Axis=ln, Scale=False)
patch = Patch(Curves=graft(railrev), Spans=20, Flexibility=1, Trim=True)  # -> flatten(Patch)
join = BrepJoin(Breps=flatten([railrev, patch]))  # -> Breps, Closed
