# Grasshopper definition molecules.gh (Grasshopper 0.9.76)

# ---- group: Atoms
carbon = Slider(60, range=20..80)
oxygen = Slider(80, range=20..80)
center = Slider(15, range=10..20)
hydrogen = Slider(39, range=20..80)
pt = ConstructPoint(XCoordinate=0, YCoordinate=0, ZCoordinate=0)
move = Move(Geometry=pt, Motion=Vector(130, 0, 0))  # -> Geometry, Transform
move_2 = Move(Geometry=move.Geometry, Motion=Vector(200, 0, 0))  # -> Geometry, Transform
center_2 = Circle(Plane=move_2.Geometry, Radius=center)
center_3 = Circle(Plane=pt, Radius=center)
center_4 = Circle(Plane=move.Geometry, Radius=center)
divide = DivideCurve(Curve=center_3, Count="1", Kinks=False)  # -> Points, Tangents, Parameters
divide_2 = DivideCurve(Curve=center_4, Count="4", Kinks=False)  # -> Points, Tangents, Parameters
divide_3 = DivideCurve(Curve=center_2, Count="2", Kinks=False)  # -> Points, Tangents, Parameters
division = Division(A=3.141592654, B="1")
division_2 = Division(A=3.141592654, B="4")
division_3 = Division(A=3.141592654, B="2")

# ---- group: To bake!
H = Circle(Plane=pt, Radius=hydrogen)
C = Circle(Plane=move.Geometry, Radius=carbon)
O = Circle(Plane=move_2.Geometry, Radius=oxygen)

# ---- group: Atoms (continued)
divide_4 = DivideCurve(Curve=H, Count="1", Kinks=False)  # -> Points, Tangents, Parameters
divide_5 = DivideCurve(Curve=C, Count="4", Kinks=False)  # -> Points, Tangents, Parameters
divide_6 = DivideCurve(Curve=O, Count="2", Kinks=False)  # -> Points, Tangents, Parameters
ln = Line(StartPoint=divide.Points, EndPoint=divide_4.Points)
ln_2 = Line(StartPoint=divide_2.Points, EndPoint=divide_5.Points)
ln_3 = Line(StartPoint=divide_3.Points, EndPoint=divide_6.Points)

# ---- group: connection
chamfer = Slider(1.5, range=0.5..2)
thickness = Slider(4, range=2..5)
lenght = Slider(20, range=10..20)
kerf = Slider(0.16, range=0..0.3)
division_4 = Division(A=thickness, B=2)
subtraction = Subtraction(A=division_4, B=kerf)
pt_2 = ConstructPoint(XCoordinate=0, YCoordinate=0, ZCoordinate=0)
addition = Addition(A=subtraction, B=chamfer)
vec = VectorXYZ(XComponent=expr("-x", chamfer), YComponent=chamfer, ZComponent=0)  # -> Vector, Length
X = UnitX(Factor=expr("-x", subtraction))
X_2 = UnitX(Factor=addition)
Y = UnitY(Factor=lenght)
move_3 = Move(Geometry=pt_2, Motion=X_2)  # -> Geometry, Transform
move_4 = Move(Geometry=move_3.Geometry, Motion=vec.Vector)  # -> Geometry, Transform
move_5 = Move(Geometry=move_4.Geometry, Motion=Y)  # -> Geometry, Transform
move_6 = Move(Geometry=move_5.Geometry, Motion=X)  # -> Geometry, Transform
pline = PolyLine(Vertices=[move_3.Geometry, move_4.Geometry, move_5.Geometry, move_6.Geometry], Closed=False)
mirror = Mirror(Geometry=pline, Plane=PlaneYZ(0, 0, 0))  # -> Geometry, Transform
join = JoinCurves(Curves=[mirror.Geometry, pline], Preserve=False)
vec2pt = Vector2Pt(PointA=divide_5.Points, PointB=move.Geometry, Unitize=False)  # -> Vector, Length
vec2pt_2 = Vector2Pt(PointA=divide_6.Points, PointB=move_2.Geometry, Unitize=False)  # -> Vector, Length
vec2pt_3 = Vector2Pt(PointA=pt_2, PointB=divide_4.Points, Unitize=False)  # -> Vector, Length
vec2pt_4 = Vector2Pt(PointA=pt_2, PointB=divide_5.Points, Unitize=False)  # -> Vector, Length
vec2pt_5 = Vector2Pt(PointA=divide_4.Points, PointB=pt, Unitize=False)  # -> Vector, Length
vec2pt_6 = Vector2Pt(PointA=pt_2, PointB=divide_6.Points, Unitize=False)  # -> Vector, Length
move_7 = Move(Geometry=join, Motion=[vec2pt_3.Vector, vec2pt_4.Vector, vec2pt_6.Vector])  # -> Geometry, Transform
Y_2 = UnitY(Factor=1)
xy = XYPlane(Origin=Point(0, 0, 0))
angle = Angle(VectorA=Y_2, VectorB=[vec2pt_5.Vector, vec2pt.Vector, vec2pt_2.Vector], Plane=xy)  # -> Angle, Reflex

# ---- group: To bake! (continued)
rotate = Rotate(Geometry=ln, Angle=division, Plane=pt)  # -> Geometry, Transform
rotate_2 = Rotate(Geometry=ln_2, Angle=division_2, Plane=move.Geometry)  # -> Geometry, Transform
rotate_3 = Rotate(Geometry=ln_3, Angle=division_3, Plane=move_2.Geometry)  # -> Geometry, Transform

# ---- group: to bake!
rotate_4 = Rotate(Geometry=move_7.Geometry, Angle=angle.Angle, Plane=[divide_4.Points, divide_5.Points, divide_6.Points])  # -> Geometry, Transform
