# Grasshopper definition unfold_curve.gh (Grasshopper 0.9.76)
# plug-ins: HoopSnake

number_slider = Slider(40, range=6..50)
crv = Curve(<curve referenced from the Rhino model>)
end = EndPoints(Curve=crv)  # -> Start, End
divide = DivideCurve(Curve=crv, Count=number_slider, Kinks=False)  # -> Points, Tangents, Parameters
rev = ReverseList(List=divide.Points)
item = ListItem(List=rev, Index=1, Wrap=True)
split = SplitList(List=rev, Index=number_slider)  # -> ListA, ListB
shift = ShiftList(List=rev, Shift=1, Wrap=False)
ln = Line(StartPoint=split.ListA, EndPoint=shift)
split_2 = SplitList(List=ln, Index=expr("x-1", number_slider))  # -> ListA, ListB
shift_2 = ShiftList(List=ln, Shift=1, Wrap=False)
angle = Angle(VectorA=split_2.ListA, VectorB=shift_2)  # -> Angle, Reflex
deg = Degrees(Radians=angle.Angle)
panel = Panel(deg)
xprod = CrossProduct(VectorA=split_2.ListA, VectorB=shift_2, Unitize=False)  # -> Vector, Length
unit = UnitVector(Vector=xprod.Vector)
smash = Slider(0.675, range=0..1)
devec = DeconstructVector(Vector=unit)  # -> XComponent, YComponent, ZComponent
multiplication = Multiplication(A=devec.ZComponent, B=angle.Angle)
multiplication_2 = Multiplication(A=multiplication, B=smash)
lng = ListLength(List=rev)
X = UnitX(Factor=1)

# ---- group: Loop
item_2 = ListItem(List=hs.Feedback, Index=hs.IterationsCounter, Wrap=True)
end_2 = EndPoints(Curve=item_2)  # -> Start, End
item_3 = ListItem(List=multiplication_2, Index=hs.IterationsCounter, Wrap=True)
split_3 = SplitList(List=hs.Feedback, Index=hs.IterationsCounter)  # -> ListA, ListB
rotate = Rotate(Geometry=split_3.ListB, Angle=expr("x*(-1)", item_3), Plane=end_2.Start)  # -> Geometry, Transform
merge = Merge(Data1=split_3.ListA, Data2=rotate.Geometry)  # -> flatten(Result)

# ----
end_3 = EndPoints(Curve=merge)  # -> Start, End
intcrv = Interpolate(Vertices=end_3.Start, Degree=3, Periodic=False, KnotStyle=1)  # -> Curve, Length, Domain
end_4 = EndPoints(Curve=intcrv.Curve)  # -> Start, End
vec2pt = Vector2Pt(PointA=end_4.Start, PointB=end_4.End, Unitize=False)  # -> Vector, Length
angle_2 = Angle(VectorA=vec2pt.Vector, VectorB=X)  # -> Angle, Reflex
open_profile = Rotate(Geometry=intcrv.Curve, Angle=angle_2.Angle, Plane=end_4.Start)  # -> Geometry, Transform

# ---- group: Loop (continued)
smaller = SmallerThan(FirstNumber=hs.IterationsCounter, SecondNumber=lng)  # -> SmallerThan, OrEqualTo
hs = HoopSnake(
    StartingData=ln,
    Data=merge,
    TerminationCondition=smaller.SmallerThan,
    Trigger=Toggle(True),
    Hoopsnake_Data_autoUpdate=True,
    Hoopsnake_Data_dataLimit=2147483647,
    Hoopsnake_Data_delay=0,
    Hoopsnake_Data_resetCounter=False,
    Hoopsnake_Data_updateView=True)  # -> Feedback, CumulativeFeedback, LoopsCounter, IterationsCounter
